# Grasshopper definition Geometry.gh (Grasshopper 1.0.7)
# plug-ins: LunchBox

file_path = FilePath()
file_path_2 = FilePath()
file_path_3 = FilePath()
ghpython_script = GhPythonScript(control_file=file_path_3, input_folder=file_path, output_folder=file_path_2)  # -> a, excel_path, excel_save_path, thermal_png_path, heatmap_png_path, model_name, b
# ---------- ghpython_script: Python ----------
import os

model_name = ""
excel_path = None
excel_save_path = None
thermal_png_path = None
heatmap_png_path = None

# 自动读取控制文件中的模型名
if control_file and os.path.exists(control_file):
    with open(control_file, "r") as f:
        model_name = f.read().strip()

# 输入 Excel
if model_name and input_folder:
    excel_path = os.path.join(input_folder, model_name + ".xlsx")

# 输出 Excel
if model_name and output_folder:
    excel_save_path = os.path.join(output_folder, model_name + ".xlsx")

# 输出 Thermal Map PNG
if model_name and output_folder:
    thermal_png_path = os.path.join(output_folder, model_name + "_thermal.png")

# 输出 Spatial Heatmap PNG
if model_name and output_folder:
    heatmap_png_path = os.path.join(output_folder, model_name + "_heatmap.png")

# 输出云图路径给 GH
a = excel_path
b = excel_save_path
c = thermal_png_path
d = heatmap_png_path
e = model_name
# ---------- end ghpython_script ----------
excel_reader = ExcelReader(ReadExcelData=Toggle(False), WorkbookPath=ghpython_script.excel_path, WorksheetName="Sheet1")  # -> Exceptions, ExcelData
flatten_tree = FlattenTree(Tree=excel_reader.ExcelData, Path="{0}")
partition_list = PartitionList(List=flatten_tree, Size=[3, 2])
list_item = ListItem(List=partition_list, Index=0, Wrap=True)
list_item_2 = ListItem(List=partition_list, Index=0, Wrap=True)
construct_point = ConstructPoint(XCoordinate=list_item, YCoordinate=list_item_2, ZCoordinate=0)
flatten_tree_2 = FlattenTree(Tree=construct_point, Path="{0}")
deconstruct = Deconstruct(Point=flatten_tree_2)  # -> XComponent, YComponent, ZComponent
average = Average(Input=deconstruct.XComponent)
average_2 = Average(Input=deconstruct.YComponent)
construct_point_2 = ConstructPoint(XCoordinate=average, YCoordinate=average_2, ZCoordinate=0)
vector_2pt = Vector2Pt(PointA=construct_point_2, PointB=flatten_tree_2, Unitize=False)  # -> Vector, Length
deconstruct_vector = DeconstructVector(Vector=vector_2pt.Vector)  # -> XComponent, YComponent, ZComponent
expression = Expression(x=deconstruct_vector.XComponent, y=deconstruct_vector.YComponent, Expression="atan2(y, x)")
sort_list = SortList(Keys=expression, ValuesValuesA=flatten_tree_2)  # -> Keys, ValuesValuesA
polyline = PolyLine(Vertices=sort_list.ValuesValuesA, Closed=True)
boundary_surfaces = BoundarySurfaces(Edges=polyline)
list_length = ListLength(List=flatten_tree_2)
