# Grasshopper definition MRT.gh (Grasshopper 1.0.7)

file_path = FilePath()
solarbodypar = LBSolarBodyParameters()  # -> sol_body_par; plug-in component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
geometry = Geometry()
geometry_2 = Geometry()
geometry_3 = Geometry()
importepw = LBImportEPW(epw_file=file_path)  # -> location, dry_bulb_temperature, dew_point_temperature, relative_humidity, wind_speed, wind_direction, direct_normal_rad, diffuse_horizontal_rad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; plug-in component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
merge = Merge(Data1=geometry, Data2=geometry_2, Data3=geometry_3)
boundary_surfaces = BoundarySurfaces()
genpts = LBGeneratePointGrid(geometry=boundary_surfaces)  # -> points, vectors, face_areas, mesh; plug-in component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
humantosky = LBHumanToSkyRelation(
    location=importepw.location,
    position=flatten(genpts.points),
    context=flatten(merge),
    cpu_count=Toggle(False),
    run=Toggle(False))  # -> out, human_points, human_line, fract_body_exp, sky_exposure; plug-in component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
matrix = LBConstructMatrix(values=humantosky.fract_body_exp)  # -> matrix; plug-in component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
analysisperiod = LBAnalysisPeriod(start_month=1, start_day=1, start_hour=0)  # -> period, hoys, dates; plug-in component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
outdoorsolarmrt = LBOutdoorSolarMRT(
    location=importepw.location,
    surface_temp=importepw.dry_bulb_temperature,
    dir_norm_rad=importepw.direct_normal_rad,
    diff_horiz_rad=importepw.diffuse_horizontal_rad,
    horiz_infrared=importepw.horizontal_infrared_rad,
    fract_body_exp=humantosky.fract_body_exp,
    sky_exposure=humantosky.sky_exposure,
    solar_body_par=solarbodypar,
    run=Toggle(False))  # -> out, short_erf, long_erf, short_dmrt, long_dmrt, mrt; plug-in component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
vizthermalmap = HBVisualizeThermalMap(comf_mtx=matrix, mesh=flatten(genpts.mesh))  # -> out, mesh, legend, title, colors, values; plug-in component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
matrix_2 = LBConstructMatrix(values=outdoorsolarmrt.mrt)  # -> matrix; plug-in component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
vizthermalmap_2 = HBVisualizeThermalMap(comf_mtx=matrix_2, mesh=flatten(genpts.mesh), period=analysisperiod.period)  # -> out, mesh, legend, title, colors, values; plug-in component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
