# Grasshopper definition UTCI.gh (Grasshopper 1.0.7)
# plug-ins: LunchBox, Human, eleFront

file_path = FilePath()
importepw = LBImportEPW(epw_file=file_path)  # -> location, dry_bulb_temperature, dew_point_temperature, relative_humidity, wind_speed, wind_direction, direct_normal_rad, diffuse_horizontal_rad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; plug-in component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
outdoorsolarmrt = LBOutdoorSolarMRT()  # -> out, short_erf, long_erf, short_dmrt, long_dmrt, mrt; plug-in component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
colrange = LBColorRange(index=Slider(1, range=0..10))  # -> colors; plug-in component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
file_path_2 = FilePath()
legendpar = LBLegendParameters(colors=colrange)  # -> leg_par; plug-in component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
analysisperiod = LBAnalysisPeriod(start_month=1, start_day=1, start_hour=0)  # -> period, hoys, dates; plug-in component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
utci = LBUTCIComfort(
    air_temp=importepw.dry_bulb_temperature,
    mrt=outdoorsolarmrt.mrt,
    rel_humid=importepw.relative_humidity,
    wind_vel=file_path_2,
    run=Toggle(False))  # -> out, utci, comfort, condition, category, comf_obj; plug-in component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
ghpython_script = GhPythonScript()  # -> a, excel_path, excel_save_path, thermal_png_path, heatmap_png_path, model_name, b
# ---------- ghpython_script: Python ----------
import os

model_name = ""
excel_path = None
excel_save_path = None
thermal_png_path = None
heatmap_png_path = None

# 自动读取控制文件中的模型名
if control_file and os.path.exists(control_file):
    with open(control_file, "r") as f:
        model_name = f.read().strip()

# 输入 Excel
if model_name and input_folder:
    excel_path = os.path.join(input_folder, model_name + ".xlsx")

# 输出 Excel
if model_name and output_folder:
    excel_save_path = os.path.join(output_folder, model_name + ".xlsx")

# 输出 Thermal Map PNG
if model_name and output_folder:
    thermal_png_path = os.path.join(output_folder, model_name + "_thermal.png")

# 输出 Spatial Heatmap PNG
if model_name and output_folder:
    heatmap_png_path = os.path.join(output_folder, model_name + "_heatmap.png")

# 输出云图路径给 GH
a = excel_path
b = excel_save_path
c = thermal_png_path
d = heatmap_png_path
e = model_name
# ---------- end ghpython_script ----------
genpts = LBGeneratePointGrid()  # -> points, vectors, face_areas, mesh; plug-in component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
comfstat = LBComfortStatistics(comf_obj=utci.comf_obj)  # -> pct_hot, pct_neutral, pct_cold; plug-in component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
matrix = LBConstructMatrix(values=utci.utci)  # -> matrix; plug-in component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
excel_write = ExcelWrite(
    WriteExcelData=Toggle(False),
    WorkbookPath=ghpython_script.excel_save_path,
    WorksheetName="Sheet1",
    Data=comfstat.pct_neutral,
    ClearSheet=False)
heatmap = LBSpatialHeatmap(values=comfstat.pct_neutral, mesh=genpts.mesh, legend_par=legendpar)  # -> mesh, legend, title, colors, legend_par, vis_set; plug-in component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
vizthermalmap = HBVisualizeThermalMap(comf_mtx=matrix, mesh=flatten(genpts.mesh), period=analysisperiod.period)  # -> out, mesh, legend, title, colors, values; plug-in component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
save_viewport_to_file = SaveViewportToFile(Run=Toggle(False), Render=False, FilePath=ghpython_script.heatmap_png_path, ScaleFactor=1)
merge = Merge(Data1=heatmap.mesh, Data2=heatmap.legend)
bake_objects = BakeObjects(Geometry=merge, Bake=Toggle(False), createGroups=False)  # -> Message, Ghosts
file_path_3 = FilePath(save_viewport_to_file)
save_viewport_to_file_2 = SaveViewportToFile(Run=Toggle(False), Render=False, FilePath=ghpython_script.thermal_png_path, ScaleFactor=1)
file_path_4 = FilePath(save_viewport_to_file_2)
